vi "Generate Waveform (Multi-Array).gvi"   [LabVIEW NXG 4.0.0]
inputs:
  "tx config in": T2 = {"rf enable 0"=FALSE, "rf config 0"={"antenna"="TX1", "frequency"=2000000000, "lo frequency"=-1, "level"=0}, "rf enable 1"=FALSE, "rf config 1"={"antenna"="TX1", "frequency"=2000000000, "lo frequency"=-1, "level"=0}, "transfer mode"="Finite", "sample rate"=10000000, "number of samples"=8192, "start trigger"="Immediate", "tone frequency"=100000}
  "number of samples": u32 = 300000
  "sample rate": f64 = 10000000
  "tone frequency": f64 = 130000
  "amplitude": f64 = 1
outputs:
  "Sample Number": u32
  "i": i16[]
  "q": i16[]
  "waveform": waveform<f64>[]
  "error out": error
  "Fs": f64
  "tx config out": T2
types:
  T1 = cluster{"antenna": string, "frequency": f64, "lo frequency": f64, "level": f64}
  "Start Trigger.gtype" = enum{"Software", "Digital Edge", "Rx Start Trigger", "Tx Start Trigger", "Immediate", "Future Time Event"}
  T2 = cluster{"rf enable 0": bool, "rf config 0": T1, "rf enable 1": bool, "rf config 1": T1, "transfer mode": enum{"Finite", "Continuous"}, "sample rate": f64, "number of samples": u32, "start trigger": "Start Trigger.gtype", "tone frequency": f64}
uses:
  GenLTEFrame1TxAnt.mli::GetLTEFrame1TxAnt
  NI::G Core::File IO (General)::Write Delimited Spreadsheet (Waveform Array).gvi
  NI::Analysis::Generation::Sine Waveform.gvi
diagram:
  call "GetLTEFrame1TxAnt"() -> (ComplexSamples=w1, Fs=w2)
  Property Node(instance in=$"tx config in") -> (instance out=w3)
  Array Size(array=w1) -> (size(s)=w4)
  To Unsigned 32 Bit Integer(number=w4) -> w5
  Property Node(instance in=w3, "number of samples"=w5, "sample rate"=w2) -> (instance out=w6)
  $"tx config out" <- w6
  $"Sample Number" <- w5
  $Fs <- w2
  Complex To Real And Imaginary(x + iy=w1) -> (x=w7, y=w8)
  Reciprocal(x=w2) -> w9
  Build Waveform Node(Y=w7, dt=w9) -> (output waveform=w10)
  Build Waveform Node(Y=w8, dt=w9) -> (output waveform=w11)
  Build Array(w10, w11) -> w12
  call "Write Delimited Spreadsheet (Waveform Array).gvi"(delimiter=";", file=path "C:\\Users\\ge69mog\\Documents\\WaveformLTEFrame.csv", waveforms=w12)
  $waveform <- w12
  Property Node(instance in=w10) -> ("Y"=w13)
  Multiply(w13, 32767) -> w14
  To Signed 16 Bit Integer(number=w14) -> w15
  $i <- w15
  Property Node(instance in=w11) -> ("Y"=w16)
  Multiply(w16, 32767) -> w17
  To Signed 16 Bit Integer(number=w17) -> w18
  $q <- w18
  call "Sine Waveform.gvi"(sample rate=$"sample rate", samples=$"number of samples", amplitude=$amplitude, frequency=$"tone frequency", phase in=90) -> (error out=w19)
  call "Sine Waveform.gvi"(sample rate=$"sample rate", samples=$"number of samples", amplitude=$amplitude, frequency=$"tone frequency", phase in=0) -> (error out=w20)
  Merge Errors(w19, w20) -> (error out=w21)
  $"error out" <- w21
